# Grasshopper definition Simple workflow.gh (Grasshopper 1.0.8)
# plug-ins: JLP.Components, JLP

appartment1 = DefineSpace(Colour=RGB(255, 0, 0), Area=10, LockTransform=True)  # -> SpaceID, Transform, ExteriorPolylines

# ----
# AI
# Spaces
colour_swatch = ColourSwatch(SwatchColor=RGB(201, 74, 255))
staircase = DefineSpace(Colour=colour_swatch, Shape=<geometry referenced from the Rhino model>, Area=20, LockTransform=True)  # -> SpaceID, Transform, ExteriorPolylines
livingroom = DefineSpace(ParentID=appartment1.SpaceID, Colour=ColourSwatch(SwatchColor=RGB(247, 255, 0)), Area=12, LockTransform=True)  # -> SpaceID, Transform, ExteriorPolylines
kitchen = DefineSpace(ParentID=appartment1.SpaceID, Colour=ColourSwatch(SwatchColor=RGB(255, 0, 0)), Area=4, LockTransform=True)  # -> SpaceID, Transform, ExteriorPolylines
hallway = DefineSpace(ParentID=appartment1.SpaceID, Colour=ColourSwatch(SwatchColor=RGB(255, 126, 255)), Area=5, LockTransform=True)  # -> SpaceID, Transform, ExteriorPolylines
bedroom = DefineSpace(ParentID=appartment1.SpaceID, Colour=ColourSwatch(SwatchColor=RGB(92, 210, 0)), Area=12, LockTransform=True)  # -> SpaceID, Transform, ExteriorPolylines
bathroom = DefineSpace(ParentID=appartment1.SpaceID, Colour=ColourSwatch(SwatchColor=RGB(0, 0, 255)), Area=5, LockTransform=True)  # -> SpaceID, Transform, ExteriorPolylines

# ----
# Generator
api_key = APIKey()
floorplanquery = FloorplanQuery(SpaceID=appartment1.SpaceID, APIKey=api_key)  # -> Data, InstructionJSON
data2boundary = Data2Boundary(Data=floorplanquery.Data, Smoothing=3)  # -> Edges, Adjacencies, Unassigned, Colours

# ----
# Connections
defineconnection = DefineConnection(SpaceA=livingroom.SpaceID, SpaceB=kitchen.SpaceID)
defineconnection_2 = DefineConnection(SpaceA=livingroom.SpaceID, SpaceB=hallway.SpaceID)
defineconnection_3 = DefineConnection(SpaceA=hallway.SpaceID, SpaceB=bedroom.SpaceID)
defineconnection_4 = DefineConnection(SpaceA=hallway.SpaceID, SpaceB=bathroom.SpaceID)
defineconnection_5 = DefineConnection(SpaceA=hallway.SpaceID, SpaceB=staircase.SpaceID)
defineconnection_6 = DefineConnection(SpaceA=staircase.SpaceID)

flip_matrix = FlipMatrix(Data=data2boundary.Adjacencies)
create_material = CreateMaterial(Diffuse=data2boundary.Colours, Specular=RGB(0, 0, 0), Emission=RGB(0, 0, 0), Transparency=0, Shine=0)
# Rooms
cull_pattern = CullPattern(List=data2boundary.Edges, CullPattern=flip_matrix)
join_curves = JoinCurves(Curves=simplify(cull_pattern), Preserve=False)  # -> simplify(flatten(Curves))
cull_index = CullIndex(List=join_curves, Indices=-1, Wrap=True)
boundary_surfaces = BoundarySurfaces(Edges=graft(cull_index))  # -> flatten(Surfaces)
custom_preview = CustomPreview(Geometry=boundary_surfaces, Material=create_material)
